# Grasshopper definition SA-GH-SolarInterrupted_pythonWIP.gh (Grasshopper 1.0.7)
# plug-ins: treesloth01, HFTidyCanvas

ladybug = Ladybug_Ladybug()  # -> Vviiiiiiiiiizzz; plug-in component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
sunlighthoursanalysis = Ladybug_SunlightHoursAnalysis(timeStep=1, runIt=Toggle(True))  # -> readMe, contextMesh, analysisMesh, testPts, testVec, port, sunlightHoursResult, sunlightHoursMesh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; plug-in component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
panel = Panel(ladybug)
panel_2 = Panel(sunlighthoursanalysis.readMe)
sunvisible = SunVisible(sunlighthoursanalysis.sunIsVisible)
timestep = DataDescription()
analysismesh = Data(sunlighthoursanalysis.analysisMesh)

# ---- group: FindInsTime/SortMeshes
shift = ShiftPaths(Data=sunvisible, Offset=-1)
tstat = TreeStatistics(Tree=shift)  # -> Paths, Length, Count
tstat_2 = TreeStatistics(Tree=analysismesh)  # -> Paths, Length, Count
replace = ReplacePaths(Data=shift, Search=tstat.Paths, Replace=tstat_2.Paths)
sunvisible_2 = SunVisible(replace)
data = DataDescription(analysismesh)
sunvisible_3 = SunVisible(sunvisible_2)
timestep_2 = TimeStep(timestep)
cull_i = CullIndex(List=sunvisible_2, Indices=-1, Wrap=True)
cull_i_2 = CullIndex(List=sunvisible_2, Indices=0, Wrap=True)
shift_2 = ShiftPaths(Data=cull_i, Offset=-1)
shift_3 = ShiftPaths(Data=cull_i_2, Offset=-1)
merge = Merge(Data1=graft(shift_2), Data2=graft(shift_3))
ma = MassAddition(Input=merge)  # -> Result, PartialResults
int = Integer(ma.Result)
int_2 = Integer("1")
mindex = MemberIndex(Set=int, Member=int_2)  # -> Index, Count
clean = CleanTree(RemoveNulls=True, RemoveInvalid=True, RemoveEmpty=True, Tree=mindex.Index)
shift_4 = ShiftPaths(Data=clean, Offset=-1)
tstat_3 = TreeStatistics(Tree=shift_4)  # -> Paths, Length, Count
dpath = DeconstructPath(Branch=tstat_3.Paths)
lng = ListLength(List=dpath)  # -> expr("x-1", Length)
split = SplitList(List=dpath, Index=lng)  # -> ListA, ListB
path = ConstructPath(Indices=split.ListA)  # -> flatten(Branch)
clone = CloneStructure(List=flatten(split.ListB), Structure=flatten(path))
branch = DataDescription(path)
branch_2 = Branch(branch)
int_3 = Integer(clone)
int_4 = Integer("0")
split_2 = SplitTree(Data=data, Masks=flatten(branch_2))  # -> Positive, Negative
split_3 = SplitTree(Data=sunvisible_3, Masks=flatten(branch_2))  # -> Positive, Negative
mindex_2 = MemberIndex(Set=int_3, Member=int_4)  # -> Index, Count
int_5 = Integer("1")
interruptedrays = DataDescription(split_3.Positive)
timestep_3 = TimeStep(timestep_2)
interruptedmeshes = DataDescription(split_2.Positive)
replace_2 = ReplaceItems(List=int_3, Item=int_5, Indices=mindex_2.Index, Wrap=False)
addition = Addition(A=clone, B=1)
addition_2 = Addition(A=clone, B=1)
shift_5 = ShiftPaths(Data=replace_2, Offset=-2)
lng_2 = ListLength(List=interruptedrays)  # -> expr("x", Length)
ins = InsertItems(List=addition, Item=0, Indices=0, Wrap=True)
ins_2 = InsertItems(List=addition_2, Item=lng_2, Indices=-1, Wrap=True)
dcon = DeleteConsecutive(Set=ins, Wrap=False)  # -> Set, Count
dcon_2 = DeleteConsecutive(Set=ins_2, Wrap=False)  # -> Set, Count
subtraction = Subtraction(A=dcon_2.Set, B=dcon.Set)
dcon_3 = DeleteConsecutive(Set=interruptedrays, Wrap=False)  # -> Set, Count
dispatch = Dispatch(List=subtraction, DispatchPattern=dcon_3.Set)  # -> ListA, ListB
shift_6 = ShiftPaths(Data=dispatch.ListA, Offset=-2)
fullmesh = DataDescription(split_2.Negative)
int_6 = Integer("1")
fullrays = DataDescription(split_3.Negative)
lng_3 = ListLength(List=shift_6)
mindex_3 = MemberIndex(Set=fullrays, Member=int_6)  # -> Index, Count
int_7 = Integer("1")
mindex_4 = MemberIndex(Set=flatten(lng_3), Member=int_7)  # -> Index, Count
tstat_4 = TreeStatistics(Tree=shift_6)  # -> Paths, Length, Count
item = ListItem(List=tstat_4.Paths, Index=mindex_4.Index, Wrap=True)
interruptedmeshes_2 = Positive(interruptedmeshes)
data_2 = DataDescription(shift_6)
masks = DataDescription(item)
split_4 = SplitTree(Data=data_2, Masks=flatten(masks))  # -> Positive, Negative
split_5 = SplitTree(Data=interruptedmeshes_2, Masks=flatten(masks))  # -> Positive, Negative
fullrays_2 = FullRays(mindex_3.Count)
directmesh = DataDescription(split_5.Positive)
directrays = DataDescription(split_4.Positive)
interruptedmesh = DataDescription(split_5.Negative)
fullmesh_2 = FullMesh(fullmesh)
interruptedrays_2 = DataDescription(split_4.Negative)
shift_7 = ShiftList(List=interruptedrays_2, Shift=-1, Wrap=False)
shift_8 = ShiftList(List=interruptedrays_2, Shift=1, Wrap=False)
addition_3 = Addition(A=shift_7, B=shift_8)
bnd = Bounds(Numbers=addition_3)
dedomain = DeconstructDomain(Domain=bnd)  # -> Start, End
shift_9 = ShiftPaths(Data=dedomain.End, Offset=-1)
fullmesh_3 = FullMesh(fullmesh_2)
interruptedmesh_2 = Negative(interruptedmesh)
interruptedrays_3 = DataDescription(shift_9)
timestep_4 = TimeStep(timestep_3)
fullrays_3 = FullRays(fullrays_2)
directmesh_2 = DirectMesh(directmesh)
directrays_2 = DirectRays(directrays)
entwine = Entwine(Branch0X=fullmesh_3, Branch1X=directmesh_2, Branch2X=interruptedmesh_2, FlattenInputs=False)
entwine_2 = Entwine(Branch0X=fullrays_3, Branch1X=directrays_2, Branch2X=interruptedrays_3, FlattenInputs=False)
mesh = DataDescription(entwine)
rays = DataDescription(entwine_2)
timestep_5 = TimeStep(timestep_4)
division = Division(A=rays, B=timestep_5)

# ----
wip = Ladybug_Template(test="test")  # -> out, test; plug-in component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
path_2 = FilePath("C:\Users\ilide\Desktop\archimatika tech\ladybug\!tmp\")
exportladybug = Ladybug_ExportLadybug(components=wip.test, targetFolder=path_2, export=Toggle(False))  # -> readMe; plug-in component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
panel_3 = Panel(exportladybug)
time = Rays(division)
mesh_2 = Mesh(mesh)
